# Grasshopper definition MainBoardHousing.gh (Grasshopper 0.9.76)

# Mounting Hole Position
pt = Point(Point(0, 0, 0))
multiplication = Multiplication(A="1.40", B=25.4)
X = UnitX(Factor=multiplication)
division = Division(A=multiplication, B=2)
pt_2 = ConstructPoint(XCoordinate=division, YCoordinate=0, ZCoordinate=0)
Z = UnitZ(Factor=1)
pl = ConstructPlane(Origin=pt_2, XAxis=Vector(1, 0, 0), YAxis=Vector(0, 1, 0))
pl_2 = ConstructPlane(Origin=pt_2, XAxis=Z, YAxis=Vector(0, 1, 0))
multiplication_2 = Multiplication(A="0.05", B=25.4)
multiplication_3 = Multiplication(A="0.15", B=25.4)
circle = CircleCNR(Center=pt, Normal=Vector(0, 0, 1), Radius=multiplication_2)
circle_2 = CircleCNR(Center=pt, Normal=Vector(0, 0, 1), Radius=multiplication_3)
divide = DivideCurve(Curve=circle_2, Count="4", Kinks=False)  # -> Points, Tangents, Parameters
boundary = BoundarySurfaces(Edges=circle)
bang = ExplodeTree(Data=simplify(graft(divide.Points)))  # -> Branch0, Branch1, Branch2, Branch3
panel = Panel("""-0.2
0.2
-0.1""")
# Box Size
panel_2 = Panel("""1
2.5
1.1""")
panel_3 = Panel("""-0.2
-0.2
+0.2""")
multiplication_4 = Multiplication(A=graft(panel_2), B=25.4)
arc = Arc3Pt(PointA=bang.Branch1, PointB=bang.Branch2, PointC=bang.Branch3)  # -> Arc, Plane, Radius
addition = Addition(A=graft(panel_2), B=graft(panel))
ln = Line(StartPoint=bang.Branch1, EndPoint=bang.Branch3)
rec_3pt = Rectangle3Pt(PointA=bang.Branch1, PointB=bang.Branch3, PointC=bang.Branch0)  # -> Rectangle, Length
addition_2 = Addition(A=graft(panel_2), B=graft(panel_3))
multiplication_5 = Multiplication(A=addition, B=25.4)
bang_2 = ExplodeTree(Data=multiplication_4)  # -> Branch0, Branch1, Branch2
multiplication_6 = Multiplication(A=addition_2, B=25.4)
join = JoinCurves(Curves=[arc.Arc, ln, rec_3pt.Rectangle], Preserve=False)
bang_3 = ExplodeTree(Data=multiplication_5)  # -> Branch0, Branch1, Branch2
bang_4 = ExplodeTree(Data=multiplication_6)  # -> Branch0, Branch1, Branch2
division_2 = Division(A=bang_2.Branch0, B=2)
division_3 = Division(A=bang_2.Branch1, B=2)
neg = Negative(Value=division_2)
neg_2 = Negative(Value=division_3)
boundary_2 = BoundarySurfaces(Edges=join)
division_4 = Division(A=bang_3.Branch0, B=2)
division_5 = Division(A=bang_3.Branch1, B=2)
neg_3 = Negative(Value=division_4)
neg_4 = Negative(Value=division_5)
division_6 = Division(A=bang_4.Branch0, B=2)
division_7 = Division(A=bang_4.Branch1, B=2)
neg_5 = Negative(Value=division_6)
neg_6 = Negative(Value=division_7)
dom = ConstructDomain(DomainStart=division_2, DomainEnd=neg)
dom_2 = ConstructDomain(DomainStart=division_3, DomainEnd=neg_2)
pln = Plane(pl)
sunion = SolidUnion(Breps=boundary_2)
dom_3 = ConstructDomain(DomainStart=division_4, DomainEnd=neg_3)
dom_4 = ConstructDomain(DomainStart=division_5, DomainEnd=neg_4)
dom_5 = ConstructDomain(DomainStart=division_6, DomainEnd=neg_5)
dom_6 = ConstructDomain(DomainStart=division_7, DomainEnd=neg_6)
num = Number(bang_2.Branch2)
sdiff = SolidDifference(BrepsA=sunion, BrepsB=boundary)
rectangle = Rectangle(Plane=pln, XSize=dom, YSize=dom_2, Radius=0)  # -> Rectangle, Length
mirror = Mirror(Geometry=sdiff, Plane=pl_2)  # -> Geometry, Transform
rectangle_2 = Rectangle(Plane=pln, XSize=dom_3, YSize=dom_4, Radius=0)  # -> Rectangle, Length
rectangle_3 = Rectangle(Plane=pln, XSize=dom_5, YSize=dom_6, Radius=0)  # -> Rectangle, Length
multiplication_7 = Multiplication(A="0.1", B=25.4)
offset = Offset(Curve=rectangle.Rectangle, Distance=multiplication_7, Plane=pln, Corners=1)
boundary_3 = BoundarySurfaces(Edges=rectangle.Rectangle)
boundary_4 = BoundarySurfaces(Edges=rectangle_2.Rectangle)
boundary_5 = BoundarySurfaces(Edges=rectangle_3.Rectangle)
boundary_6 = BoundarySurfaces(Edges=offset)
addition_3 = Addition(A=num, B=multiplication_7)
Z_2 = UnitZ(Factor=num)
Z_3 = UnitZ(Factor=addition_3)
extr = Extrude(Base=[mirror.Geometry, sdiff], Direction=Z_3)
Z_4 = UnitZ(Factor=bang_3.Branch2)
Z_5 = UnitZ(Factor=bang_4.Branch2)
extr_2 = Extrude(Base=boundary_4, Direction=Z_4)
extr_3 = Extrude(Base=boundary_3, Direction=Z_2)
extr_4 = Extrude(Base=boundary_6, Direction=Z_3)
extr_5 = Extrude(Base=boundary_5, Direction=Z_5)
sunion_2 = SolidUnion(Breps=[extr_3, extr_2, extr_5])
sdiff_2 = SolidDifference(BrepsA=extr_4, BrepsB=sunion_2)
sdiff_3 = SolidDifference(BrepsA=extr, BrepsB=sdiff_2)  # -> flatten(Result)
sunion_3 = SolidUnion(Breps=flatten([sdiff_3, sdiff_2]))
